# Grasshopper definition zome_small_inside.gh (Grasshopper 0.9.76)
# plug-ins: Python Interpreter

number_slider = Slider(2.3, range=0..100)
python = PythonScript(
    n=Slider(11, range=0..20),
    v=Slider(1.6, range=1..3),
    d=[Slider(60, range=0..300), Slider(30, range=0..100)],
    r=number_slider)  # -> out, c
# ---------- python: Python ----------
from __future__ import division
"""Constructs a recursive Koch curve.
    Inputs:
        n: The amount of double helixes. (int)
        v: 1.0..2.0 stretch vertically. (float)
        d: diameter (float)
    Outputs:
        c: The list of helix curves.
"""
import Rhino.Geometry as rg
import math


def Main():
    global c # as usual, you can assign to the global scope with the "global" keyword
    c = []
    GenerateCurves(n, v, d)

def drange (start, stop, step):
    r=start
    while r<stop:
        yield r
        r+=step
        
def GenerateCurves(n, v, d):
    for i in range (int(n)):
        points=[]
        b = (2*math.pi/n)*i
        for a in drange(-1*math.pi, math.pi, 0.01):
            x = (math.sin(a+b)*d/4)+(math.sin(b)*d/4)
            y = (math.cos(a+b)*d/4)+(math.cos(b)*d/4)
            z = (a/math.pi)*(d/2)*v
            points.append(rg.Point3d(x,y,z))
        c.append(rg.Curve.CreateControlPointCurve(points))
        points=[]
        for a in drange(-1*math.pi, math.pi, 0.01):
            y = (math.sin(a+b)*d/4)+(math.sin(b)*d/4)
            x = (math.cos(a+b)*d/4)+(math.cos(b)*d/4)
            z = (a/math.pi)*(d/2)*v
            points.append(rg.Point3d(x,y,z))
        c.append(rg.Curve.CreateControlPointCurve(points))


if n is None: n = 6
if v is None: v = 1.0
if d is None: d = 3

Main()
# ---------- end python ----------
pipe = Pipe(Curve=python.c, Radius=number_slider, Caps=Slider(2, range=0..10))
sunion = SolidUnion(Breps=pipe)
